# Grasshopper definition rectanglegrasshoper.gh (Grasshopper 1.0.4)

rectangle = Rectangle(Plane=PlaneXY(0, 0, 0), XSize=Slider(316, range=0..1000), YSize=Slider(261, range=0..1000), Radius=0)  # -> Rectangle, Length
debrep = DeconstructBrep(Brep=rectangle.Rectangle)  # -> Faces, Edges, Vertices
panel = Panel(debrep.Vertices)
panel_2 = Panel(debrep.Faces)
item = ListItem(List=debrep.Edges, Index=Slider(0, range=0..10), Wrap=True)
panel_3 = Panel(debrep.Edges)
divlength = DivideLength(Curve=item, Length=Slider(44, range=0..100))  # -> Points, Tangents, Parameters
rec_2pt = Rectangle2Pt(Plane=PlaneXY(0, 0, 0), PointA=Point(0, 0, 0), PointB=Point(10, 5, 0), Radius=0)  # -> Rectangle, Length
